# Requirement set LaneFollowingTestRequirements (R2020b)

## 1 [scenarioId #1] ACC_ISO_TargetDiscriminationTest
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
## 2 [scenarioId #2] ACC_ISO_AutoRetargetTest
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Rationale: ISO 22178

## 3 [scenarioId #3] ACC_ISO_CurveTest
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Rationale: ISO 15622
ISO 22178

## 4 [scenarioId #4] ACC_StopnGo
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Rationale: Real world scenario

## 5 [scenarioId #5] LFACC_DoubleCurveDecelTarget
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Rationale: Real world scenario

## 6 [scenarioId #6] LFACC_DoubleCurve_AutoRetarget
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Rationale: ~ISO 22178

## 7 [scenarioId #7] LFACC_DoubleCurveStopnGo
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Rationale: Real-world scenario

## 8 [scenarioId #8] LFACC_Curve_CutInOut
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Rationale: Real-world scenario

## 9 [scenarioId #9] LFACC_Curve _CutInOut_TooClose
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Rationale: Real-world Scenario