% Requirement links of LaneFollowingTestScenarios.mldatx (R2020b)

item 1 verifies LaneFollowingTestRequirements.slreqx#9: scenarioId #7: LFACC_DoubleCurveStopnGo
item 2 verifies LaneFollowingTestRequirements.slreqx#7: scenarioId #5: LFACC_DoubleCurveDecelTarget
item 3 verifies LaneFollowingTestRequirements.slreqx#5: scenarioId #3: ACC_ISO_CurveTest
item 4 verifies LaneFollowingTestRequirements.slreqx#10: scenarioId #8: LFACC_Curve_CutInOut
item 5 verifies LaneFollowingTestRequirements.slreqx#1: scenarioId #1: ACC_ISO_TargetDiscriminationTest
item 6 verifies LaneFollowingTestRequirements.slreqx#4: scenarioId #2: ACC_ISO_AutoRetargetTest
item 7 verifies LaneFollowingTestRequirements.slreqx#8: scenarioId #6: LFACC_DoubleCurve_AutoRetarget
item 8 verifies LaneFollowingTestRequirements.slreqx#11: scenarioId #9: LFACC_Curve _CutInOut_TooClose
item 9 verifies LaneFollowingTestRequirements.slreqx#6: scenarioId #4: ACC_StopnGo